# Grasshopper definition test_self_1.gh (Grasshopper 1.0.8)

num_2 = GetNumber(Slider(3, range=1..10), AtLeast=1, AtMost=1, Maximum=1.797693135e+308, Minimum=-1.797693135e+308, TreeAccess=False)
num_13 = GetNumber(Slider(1, range=1..10), AtLeast=1, AtMost=1, Maximum=1.797693135e+308, Minimum=-1.797693135e+308, TreeAccess=False)
addition = Addition(A=num_13, B=num_2)
context_print = ContextPrint(Text="5")
panel = Panel(addition)
context_print_2 = ContextPrint(Text=addition)
